# Grasshopper definition RelativeNeighborhood sample.gh (Grasshopper 0.9.76)
# plug-ins: Anemone, Relative Neighborhood

box = Box({Plane=Plane(origin=(1.840537744, 12.11908878, 0), x=(0, 1, 0), y=(1, 0, 0)), X=Domain(0, 14.73943597), Y=Domain(0, 17.25257638), Z=Domain(-18.87237745, 0)})
pt = Point([Point(-0.9914897252, 13.29455181, 0), Point(-0.9898748502, 29.12610116, 0), Point(21.11697413, 29.6137321, 0), Point(19.87769085, 12.04027986, 0), Point(-2.383028105, 11.09571075, 18.43410726), Point(-2.657778189, 30.76180449, 18.69614402), Point(22.66956262, 31.35395038, 18.19555224), Point(21.22586602, 11.41227503, 19.0770169)])
pop3d = Populate3D(Region=box, Count=Slider(155, range=0..400), Seed=Slider(425, range=0..1000))
pop2d = Populate2D(Region={Plane=PlaneXY(0, 0, 0), Size=Domain2(u=0..20, v=0..10)}, Count=100, Seed=Slider(754, range=0..1000))
number_slider = Slider(16, range=0..100)
loop_start = LoopStart(Repeat=Slider(1000, range=0..1000), Trigger=pt, Data=pop3d)  # -> port, Counter, Data
rng = RelativeNeighborhood(Points=pop2d)  # -> Graph, Indices
branch = TreeBranch(Tree=rng.Indices, Path=number_slider, MaintainPaths=True)
rng_2 = RelativeNeighborhood(Points=loop_start.Data)  # -> Graph, Indices
lng = ListLength(List=loop_start.Data)
item = ListItem(List=pop2d, Index=branch, Wrap=True)
item_2 = ListItem(List=pop2d, Index=number_slider, Wrap=True)
branch_2 = TreeBranch(Tree=rng.Graph, Path=number_slider, MaintainPaths=True)
item_3 = ListItem(List=loop_start.Data, Index=rng_2.Indices, Wrap=True)
graft = GraftTree(Tree=loop_start.Data, IncludeEmptyLists=True, IncludeNullItems=True)
repeat = RepeatData(Data=Slider(0.059, range=0.001..0.3), Length=lng)
cp = ClosestPoint(Point=pt, Cloud=loop_start.Data)  # -> ClosestPoint, CPIndex, Distance
vec2pt = Vector2Pt(PointA=item_2, PointB=item, Unitize=False)  # -> Vector, Length
vec2pt_2 = Vector2Pt(PointA=graft, PointB=item_3, Unitize=invert(False))  # -> Vector, Length
replace = ReplaceItems(List=repeat, Item=0, Indices=cp.CPIndex, Wrap=True)  # -> graft(List)
vdis = VectorDisplay(Anchor=item_2, Vector=vec2pt.Vector)
avr = Average(Input=vec2pt_2.Vector)
amp = Amplitude(Vector=avr, Amplitude=replace)
move = Move(Geometry=graft, Motion=amp)  # -> flatten(Geometry), Transform
cullpt = CullDuplicates(Points=move.Geometry, Tolerance=0.1, CullMode=3)  # -> Points, Indices, Valence
loop_end = LoopEnd(port=loop_start.port, Exit=False, Data=cullpt.Points, pausedState=False, state="Constant output", TimeOutVal=0)
